# Grasshopper definition Barridos_Test_01.gh (Grasshopper 1.0.7)
# plug-ins: Pufferfish, DendroGH

# ----
# Input csv Parsed
path = FilePath()
file = ReadFile(File=path, PerLineParse=True)

# ----
# Parsed Csv values [Angles, Distance]
# Internalise data
# Scan1
txt = Text(["0.7,189.2", "1.6,189.7", "2.6,189.7", "3.5,189.7", "4.5,189.7", "5.4,190.0"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])
panel = Panel(txt)
panel_2 = Panel(file)

# ----
# Spit data ","
panel_3 = Panel(",")
split = TextSplit(Text=txt, Separators=panel_3)

panel_4 = Panel(split)
dispatch = Dispatch(List=split, DispatchPattern=[True, False])  # -> ListA, ListB
panel_5 = Panel(dispatch.ListA)
panel_6 = Panel(dispatch.ListB)

# ----
# String to float
python = GhPythonScript(x=dispatch.ListA, y=dispatch.ListB)  # -> out, simplify(angleOut), simplify(DistOut)
# ---------- python: Python ----------
__author__ = "Usuario DELL"
__version__ = "2021.05.04"

import rhinoscriptsyntax as rs
import System.Convert


Angle = x
Distance = y

angleOut = System.Convert.ToDouble(Angle)
DistOut = System.Convert.ToDouble(Distance)
# ---------- end python ----------
num = Number(python.angleOut)
num_2 = Number(python.DistOut)

panel_7 = Panel(num)
num_3 = Number(flatten(num))
num_4 = Number(flatten(num_2))
# 214
# Slam
# 0
panel_8 = Panel(num_2)

lng = ListLength(List=num_4)
division = Division(A=lng, B="214")
int = Integer(division)
dom = ConstructDomain(DomainStart="214", DomainEnd="214")
range = Range(Domain=dom, Steps=int)
panel_9 = Panel(range)
partition = PartitionList(List=num_4, Size=range)  # -> simplify(Chunks)

lng_2 = ListLength(List=num_3)
# Split list by the average points capture per lap
division_2 = Division(A=lng_2, B="214")
int_2 = Integer(division_2)
dom_2 = ConstructDomain(DomainStart="214", DomainEnd="214")
range_2 = Range(Domain=dom_2, Steps=int_2)
partition_2 = PartitionList(List=num_3, Size=range_2)  # -> simplify(Chunks)
panel_10 = Panel(range_2)

# ----
# Scan1_Vuelta
tstat = TreeStatistics(Tree=partition)  # -> Paths, Length, Count
panel_11 = Panel(tstat.Paths)
panel_12 = Panel(tstat.Length)
# Scan1_Vuelta
panel_13 = Panel(tstat.Count)

item = ListItem(List=partition, Index=0, Wrap=True)
panel_14 = Panel(partition)
panel_15 = Panel(item)

panel_16 = Panel(partition_2)
series = Series(Start=0, Step=Slider(1.5, range=0..10), Count=int)
Z = UnitZ(Factor=series)

division_3 = Division(A=partition, B="100")
pt = ConstructPoint(XCoordinate=0, YCoordinate=0, ZCoordinate=0)
X = UnitX(Factor=Z)
move = Move(Geometry=pt, Motion=X)  # -> graft(Geometry), Transform
pt_2 = ConstructPoint(XCoordinate=graft(series), YCoordinate=0, ZCoordinate=division_3)
# Orient Points
ln = Line(StartPoint=move.Geometry, EndPoint=pt_2)
yz = YZPlane(Origin=Point(0, 0, 0))
rad = Radians(Degrees=partition_2)
rotate = Rotate(Geometry=ln, Angle=rad, Plane=yz)  # -> Geometry, Transform
xy = XYPlane(Origin=Point(0, 0, 0))
mirror = Mirror(Geometry=rotate.Geometry, Plane=xy)  # -> Geometry, Transform

len = Length(Curve=mirror.Geometry)
bnd = Bounds(Numbers=len)
end = EndPoints(Curve=mirror.Geometry)  # -> Start, End
dom_3 = ConstructDomain(DomainStart=Slider(0.11, range=0..1), DomainEnd=Slider(1, range=0..1))
remap = RemapNumbers(Value=len, Source=bnd, Target=dom_3)  # -> Mapped, Clipped
gradient = Gradient(
    LowerLimit=0,
    UpperLimit=1,
    Parameter=remap.Mapped,
    stops=[0: RGB(3, 201, 140), 0: RGB(0, 128, 0), 0: RGB(212, 199, 99), 0: RGB(99, 24, 142), 0: RGB(114, 74, 179), 0: RGB(105, 226, 183), 0: RGB(166, 215, 160), 0: RGB(202, 96, 103), 0.00306: RGB(0, 255, 0), 0.5: RGB(75, 0, 130), 1: RGB(207, 207, 207)])
preview = CustomPreview(Geometry=mirror.Geometry, Material=gradient)
preview_2 = CustomPreview(Geometry=end.End, Material=gradient)

# ----
# Points2Volume
number_slider = Slider(1, range=0..10)
vsettings = CreateSettings(VoxelSize=number_slider, Bandwidth=Slider(3, range=0..10), Isovalue=0, Adaptivity=Slider(0.21, range=0..1))
pt_3 = Point(end.End)
vpoints = PointsToVolume(Points=pt_3, PointRadius=Slider(1.5, range=0..10), Settings=vsettings)  # disabled
preview_3 = CustomPreview(Geometry=vpoints, Material=gradient)  # disabled

# ----
# Voxel_Mesh
number_slider_2 = Slider(1.524, range=0..10)
voxmsh = VoxelMesh(
    Points=end.End,
    Plane=PlaneXY(0, 0, 0),
    SizeX=number_slider_2,
    SizeY=number_slider_2,
    SizeZ=number_slider_2,
    Triangulate=Toggle(False))
